# Dynamo graph Fire Exit Risk Assessment_P01.10.dyn (Dynamo 2.0.2.6826)

# group: DESCRIPTION
# note: DYNAMO FILE NAME
# Fire Exit Risk Assessment.dyn
# note: ASSOCIATED REVIT FILE(S)
# Should work with any revit file whos terminal rooms have the correct paramter and input and whos doors have the correct paramter and input.
# note: AUTHOR(S)
# Daniel O'Dowd
# with thanks to Dieter Vermeulen (Autodesk) who started the node graph with the original path of travel graph.
# note: DESCRIPTION
# Currently this script serves the purpose of exporting the points of a building footprint at a level including its room exit points and final exit points. A separate guide will need to be made on the assignment of parameters to rooms and doors to give full functionality to this.
# note: DYNAMO VERSION
# 2.X
# note: WORKING REVIT VERSION(S)
# 2019
# note: REQUIRED DYNAMO PACKAGES
# Lunchbox for Dynamo 2015.11.28
# Archi-lab 2016.5.27
# Ampersand
# Clockwork

# group: Resolve jaggy path to smooth
join = List.Join()  # unwired: list0, list1
curves = PolyCurve.Curves()  # unwired: polyCurve
firstItem = List.FirstItem(list=curves@L2)
startPoint = Curve.StartPoint(curve=firstItem)
endPoint = Curve.EndPoint(curve=curves@L2)
combine = List.Combine(comb=join, list1=startPoint, list2=endPoint)
code_block = CodeBlock { 3; }
byControlPoints = NurbsCurve.ByControlPoints(points=combine, degree=code_block)

# group: Visualize results in Revit
views = Views(index=141)  # graph input
byCurve = DetailCurve.ByCurve(view=views, curve=byControlPoints)
code_block_2 = CodeBlock { "Line Style"; }
# note: *******************************************************
# From Archi-Lab package
code_block_3 = CodeBlock { "Egress Path"; }

get_line_style_by_name = Custom[Get Line Style by Name](name=code_block_3)  # This node will return a line style object by its name. Line styles can be either Drafting or Model Line Property.

# group (continued): Visualize results in Revit
setParameterByName = Element.SetParameterByName(element=byCurve, parameterName=code_block_2, value=get_line_style_by_name)

file_path = Filename("pointsfiles\connectiongraphpoints")

# group: Element Input
# note: Choose the level where to perform the assessment.
levels = Levels(index=1)  # graph input
categories = Categories(index=425)  # graph input
categories_2 = Categories(index=159)  # graph input
# note: Choose categories, representing the "OBSTACLES"
categories_3 = Categories(index=604)  # graph input
categories_4 = Categories(index=142)  # graph input
categories_5 = Categories(index=482)  # graph input

categories_6 = Categories(index=208)  # graph input

# group: Collection of Revit elements
all_elements_at_level = ElementsAtLevel(Level=levels)
getCategory = Element.GetCategory(element=all_elements_at_level)
string_from_object = FromObject(obj=getCategory)
create = List.Create(item0=categories, item1=categories_2, item2=categories_6, item3=categories_3, item4=categories_4)
string_from_object_2 = FromObject(obj=create)
eq = string_from_object@L3 == string_from_object_2  # lacing=Longest
# note: Only return the elements at the selected level
filterByBoolMask = List.FilterByBoolMask(list=all_elements_at_level, mask=eq@L2)
# note: Stairs are added separately as the category is not recognized in the "==" comparison
all_elements_of_category = ElementsOfCategory(Category=categories_5)
code_block_4 = CodeBlock(a=all_elements_of_category) { [a]; }
join_2 = List.Join(list0=filterByBoolMask.in, list1=code_block_4)
code_block_5 = CodeBlock(el=join_2)
# ---------- code_block_5.designscript (8 lines) ----------
//Rooms
el[0];
//Doors
el[1];
//Floors
el[2];
//Obstacles
el[3..List.Count(el)-1];
# ----------------------------------------

# group: Escape Route Initialization
code_block_6 = CodeBlock(Doors=code_block_5.out1) { Doors; }
code_block_7 = CodeBlock { "Asset_Fire Safety_Exit_Type"; "Room_Exit"; "Final_Exit"; }
getParameterValueByName = Element.GetParameterValueByName(element=code_block_6, parameterName=code_block_7.out0)
eq_2 = getParameterValueByName == code_block_7.out1  # lacing=Longest
filterByBoolMask_2 = List.FilterByBoolMask(list=code_block_6, mask=eq_2)
# note: Get the normal "Room Exit" doors and the "Emergency Exit" doors.
code_block_8 = CodeBlock(Room_Exit=filterByBoolMask_2.in) { Room_Exit; }
eq_3 = getParameterValueByName == code_block_7.out2  # lacing=Longest
filterByBoolMask_3 = List.FilterByBoolMask(list=code_block_6, mask=eq_3)
code_block_9 = CodeBlock(Final_Exit=filterByBoolMask_3.in) { Final_Exit; }

# group: Room Points - Same Index as corrosponding Room_Exit Door
code_block_10 = CodeBlock(room_exit_doors=code_block_8) { room_exit_doors; }
rooms = Custom[Door.Rooms](door=code_block_10)  # Gets the rooms that are connected by a given door
code_block_11 = CodeBlock { "Space_Fire Safety_Accomodation_Function"; "Terminal"; }
code_block_12 = CodeBlock { 1; }

join_3 = List.Join(list0=rooms.fromRoom, list1=rooms.toRoom)

# group (continued): Room Points - Same Index as corrosponding Room_Exit Door
code_block_13 = CodeBlock(Rooms=join_3) { Rooms; }
getParameterValueByName_2 = Element.GetParameterValueByName(element=code_block_13, parameterName=code_block_11.out0)
eq_4 = getParameterValueByName_2 == code_block_11.out1  # lacing=Longest
filterByBoolMask_4 = List.FilterByBoolMask(list=code_block_13, mask=eq_4)
finishBoundary = Room.FinishBoundary(room=filterByBoolMask_4.in)
flatten = List.Flatten(list=finishBoundary, amt=code_block_12)
startPoint_2 = Curve.StartPoint(curve=flatten)

all_rooms = CodeBlock(all_rooms=code_block_13) { all_rooms; }
finishBoundary_2 = Room.FinishBoundary(room=all_rooms)
code_block_14 = CodeBlock { 1; }
flatten_2 = List.Flatten(list=finishBoundary_2, amt=code_block_14)
startPoint_3 = Curve.StartPoint(curve=flatten_2)
byPerimeterPoints = Surface.ByPerimeterPoints(points=startPoint_3)
perimeterCurves = Surface.PerimeterCurves(surface=byPerimeterPoints)
polycurve_bycurves = Custom[[&] PolyCurve.ByCurves](curves=perimeterCurves)  # Create polycurves from an unordered list of curves.
ZAxis = Vector.ZAxis()
code_block_15 = CodeBlock { 500; }
extrude = Curve.Extrude(curve=polycurve_bycurves, direction=ZAxis, distance=code_block_15)
code_block_16 = CodeBlock { -200; }
offset = Surface.Offset(surface=extrude, distance=code_block_16)
byJoinedSurfaces = PolySurface.ByJoinedSurfaces(surfaces=offset)
perimeterCurves_2 = Surface.PerimeterCurves(surface=byJoinedSurfaces)
polycurve_bycurves_2 = Custom[[&] PolyCurve.ByCurves](curves=perimeterCurves_2)
deconstructPolyCurve = Geometry.Curves.DeconstructPolyCurve(polycurve=polycurve_bycurves_2@L1)
python_script = Python(IN[0]=deconstructPolyCurve.Points)
# ---------- python_script.python (26 lines) ----------
# Enable Python support and load DesignScript library
import clr
clr.AddReference('ProtoGeometry')
from Autodesk.DesignScript.Geometry import *

# The inputs to this node will be stored as a list in the IN variables.
points_list = IN[0]

output_points = []


for pt in points_list:
	pt_list = []
	for coord in pt:
		if coord.Z != 0:
			pass
		else:
			pt_list.append(coord)
	if pt_list:
		output_points.append(pt_list)
	else:
		pass


# Assign your output to the OUT variable.
OUT= output_points
# ----------------------------------------
all_room_boundary_points = CodeBlock(all_room_boundary_points=python_script) { all_room_boundary_points; }
code_block_17 = CodeBlock(Doors=code_block_5.out1) { Doors; }
solids = Element.Solids(element=code_block_17)
python_script_2 = Python(IN[0]=solids)
# ---------- python_script_2.python (18 lines) ----------
# Enable Python support and load DesignScript library
import clr
clr.AddReference('ProtoGeometry')
from Autodesk.DesignScript.Geometry import *

# The inputs to this node will be stored as a list in the IN variables.
door_sets = IN[0]

output_points = []

output_leafs = []
for door in door_sets:
	output_leafs.append(door[2])
		


# Assign your output to the OUT variable.
OUT= output_leafs
# ----------------------------------------
faces = Topology.Faces(topology=python_script_2)
edges = Face.Edges(face=faces)
curveGeometry = Edge.CurveGeometry(edge=edges)
python_script_3 = Python(IN[0]=curveGeometry)
# ---------- python_script_3.python (20 lines) ----------
# Enable Python support and load DesignScript library
import clr
clr.AddReference('ProtoGeometry')
from Autodesk.DesignScript.Geometry import *

# The inputs to this node will be stored as a list in the IN variables.
door_sets = IN[0]

output_points = []

output_leafs = []
for door in door_sets:
	edge_set = []
	output_leafs.append([door[0],door[5]])
	#output_leafs.append(edge_set[5])
		


# Assign your output to the OUT variable.
OUT= output_leafs
# ----------------------------------------
code_block_18 = CodeBlock { 0.01; }
byJoinedCurves = PolyCurve.ByJoinedCurves(curves=python_script_3, joinTolerance=code_block_18)
patch = Curve.Patch(curve=byJoinedCurves)
code_block_19 = CodeBlock { 200; }
offset_2 = Surface.Offset(surface=patch, distance=code_block_19)
deconstructSurface = Geometry.Surfaces.DeconstructSurface(surface=offset_2)
byPoints = Polygon.ByPoints(points=deconstructSurface.Points)
door_centre_points = Polygon.Center(polygon=byPoints)
join_4 = List.Join(list0=all_room_boundary_points, list1=door_centre_points)
exportCSV = Data.ExportCSV(filePath=file_path, data=join_4)
file_path_2 = Filename("pointsfiles\FinalExitPoints")
code_block_20 = CodeBlock { "\n"; }
code_block_21 = CodeBlock { ","; }
code_block_22 = CodeBlock(Floors=code_block_5.out2) { Floors; }
points = Floor.Points(floor=code_block_22)
byPerimeterPoints_2 = Surface.ByPerimeterPoints(points=points)

# group: Analysis Settings
vertical_clearance = DoubleInput(500)  # graph input

code_block_23 = CodeBlock(boundary_offset=vertical_clearance) { boundary_offset; }
offset_3 = Surface.Offset(surface=byPerimeterPoints_2, distance=code_block_23)
surface_z = CodeBlock(x=offset_3) { x; }

# group: Final Exit Centre Points - End Point
solids_2 = Element.Solids(element=code_block_9)
byUnion = Solid.ByUnion(solids=solids_2@@L2)
centroid = Solid.Centroid(solid=byUnion)
pointAtParameter = Surface.PointAtParameter(surface=surface_z)
Z = Point.Z(point=pointAtParameter)

list_create = List.Create(item0=centroid)

# group (continued): Final Exit Centre Points - End Point
X = Point.X(point=list_create)
Y = Point.Y(point=list_create)
byCoordinates = Point.ByCoordinates(x=X, y=Y, z=Z)

flatten_3 = List.Flatten(list=byCoordinates)
obsticle_polygon_points = Watch(flatten_3)
string_from_object_3 = FromObject(obj=obsticle_polygon_points)
join_5 = String.Join(separator=code_block_21, string0=string_from_object_3)
join_6 = String.Join(separator=code_block_20, string0=join_5)
final_exit_points = Watch(join_6)
exportCSV_2 = Data.ExportCSV(filePath=file_path_2, data=final_exit_points)
file_path_3 = Filename("pointsfiles\RoomExitPoints")

# group: Room Exit Centre Points - Start Point2
solids_3 = Element.Solids(element=code_block_8)
byUnion_2 = Solid.ByUnion(solids=solids_3@@L2)
centroid_2 = Solid.Centroid(solid=byUnion_2)
pointAtParameter_2 = Surface.PointAtParameter(surface=surface_z)
Z_2 = Point.Z(point=pointAtParameter_2)

list_create_2 = List.Create(item0=centroid_2)

# group (continued): Room Exit Centre Points - Start Point2
X_2 = Point.X(point=list_create_2)
Y_2 = Point.Y(point=list_create_2)
byCoordinates_2 = Point.ByCoordinates(x=X_2, y=Y_2, z=Z_2)

obsticle_polygon_points_2 = Watch(byCoordinates_2)
flatten_4 = List.Flatten(list=obsticle_polygon_points_2)
all_room_exit_points = Watch(flatten_4)
exportCSV_3 = Data.ExportCSV(filePath=file_path_3, data=all_room_exit_points)
file_path_4 = Filename("pointsfiles\RoomBoundaryPoints")
code_block_24 = CodeBlock { "\n"; }
code_block_25 = CodeBlock { ","; }
byPerimeterPoints_3 = Surface.ByPerimeterPoints(points=startPoint_2)
offset_4 = Surface.Offset(surface=byPerimeterPoints_3, distance=code_block_23)
perimeterCurves_3 = Surface.PerimeterCurves(surface=offset_4)
polycurve_bycurves_3 = Custom[[&] PolyCurve.ByCurves](curves=perimeterCurves_3)
integer_slider = IntegerSlider(-50, range=-500..-1 step 1)
code_block_26 = CodeBlock(x=integer_slider) { x -100; }
code_block_27 = CodeBlock { false; }
offset_5 = PolyCurve.Offset(polyCurve=polycurve_bycurves_3, signedDistance=code_block_26, extendCircular=code_block_27)
byPatch = Surface.ByPatch(closedCurve=offset_5)
byJoinedSurfaces_2 = PolySurface.ByJoinedSurfaces(surfaces=byPatch)
code_block_28 = CodeBlock { 1; }
flatten_5 = List.Flatten(list=byJoinedSurfaces_2, amt=code_block_28)
deconstructPolySurface = Geometry.Surfaces.DeconstructPolySurface(polysurface=flatten_5)
watch = Watch(deconstructPolySurface.Points)
string_from_object_4 = FromObject(obj=watch)
join_7 = String.Join(separator=code_block_25, string0=string_from_object_4)
join_8 = String.Join(separator=code_block_24, string0=join_7)
terminal_room_points = Watch(join_8)
exportCSV_4 = Data.ExportCSV(filePath=file_path_4, data=terminal_room_points)
importCSV = Data.ImportCSV()  # unwired: filePath
categories_7 = Categories(index=425)  # graph input
all_elements_of_category_2 = ElementsOfCategory(Category=categories_7)
all_rooms_2 = CodeBlock(all_rooms=all_elements_of_category_2) { all_rooms; }

# group: Gets a bunch of parameters from the rooms
code_block_29 = CodeBlock()
# ---------- code_block_29.designscript (11 lines) ----------
"Level";
"Department";
"Name";
"Number";
"Area";
"Space_Fire Safety_Accomodation_Function";
"Project_Building_Purpose Group";
"Project_Building_Risk_Profile";
"Space_Fire_Smoke_Control_Type";
"Space_Fire_Detection_Category";
"Space_Fire_Suppression_Type";
# ----------------------------------------
getParameterValueByName_3 = Element.GetParameterValueByName(element=all_rooms_2, parameterName=code_block_29.out2)
getParameterValueByName_4 = Element.GetParameterValueByName(element=all_rooms_2, parameterName=code_block_29.out0)
getParameterValueByName_5 = Element.GetParameterValueByName(element=all_rooms_2, parameterName=code_block_29.out1)
getParameterValueByName_6 = Element.GetParameterValueByName(element=all_rooms_2, parameterName=code_block_29.out3)
getParameterValueByName_7 = Element.GetParameterValueByName(element=all_rooms_2, parameterName=code_block_29.out4)
getParameterValueByName_8 = Element.GetParameterValueByName(element=all_rooms_2, parameterName=code_block_29.out5)
getParameterValueByName_9 = Element.GetParameterValueByName(element=all_rooms_2, parameterName=code_block_29.out6)
getParameterValueByName_10 = Element.GetParameterValueByName(element=all_rooms_2, parameterName=code_block_29.out7)
getParameterValueByName_11 = Element.GetParameterValueByName(element=all_rooms_2, parameterName=code_block_29.out8)
getParameterValueByName_12 = Element.GetParameterValueByName(element=all_rooms_2, parameterName=code_block_29.out9)
getParameterValueByName_13 = Element.GetParameterValueByName(element=all_rooms_2, parameterName=code_block_29.out10)

# group: Get room boundary points and convert into proper WCS coordinates
finishBoundary_3 = Room.FinishBoundary(room=all_rooms_2)
categories_8 = Categories(index=451)  # graph input
all_elements_of_category_3 = ElementsOfCategory(Category=categories_8)
string = StringInput("E/W")  # graph input
X_3 = Element.GetParameterValueByName(element=all_elements_of_category_3, parameterName=string)
string_2 = StringInput("N/S")  # graph input
Y_3 = Element.GetParameterValueByName(element=all_elements_of_category_3, parameterName=string_2)
string_3 = StringInput("Elev")  # graph input
Z_3 = Element.GetParameterValueByName(element=all_elements_of_category_3, parameterName=string_3)
string_4 = StringInput("Angle to True North")  # graph input
getParameterValueByName_14 = Element.GetParameterValueByName(element=all_elements_of_category_3, parameterName=string_4)

# group: Reliably insets room boundary points by 1) getting boundry lines 2)extrudes lines 3) offsets the face by normal 4) gets the lower lines of each face 5) gets each start point of each of the line 6) joins them into a single inset room boundary
watch_2 = Watch(finishBoundary_3)
startPoint_4 = Curve.StartPoint(curve=watch_2)
byPerimeterPoints_4 = Surface.ByPerimeterPoints(points=startPoint_4)
perimeterCurves_4 = Surface.PerimeterCurves(surface=byPerimeterPoints_4)
polycurve_bycurves_4 = Custom[[&] PolyCurve.ByCurves](curves=perimeterCurves_4)
ZAxis_2 = Vector.ZAxis()
code_block_30 = CodeBlock { 500; }
extrude_2 = Curve.Extrude(curve=polycurve_bycurves_4, direction=ZAxis_2, distance=code_block_30)
code_block_31 = CodeBlock { -200; }
offset_6 = Surface.Offset(surface=extrude_2, distance=code_block_31)
byJoinedSurfaces_3 = PolySurface.ByJoinedSurfaces(surfaces=offset_6)
perimeterCurves_5 = Surface.PerimeterCurves(surface=byJoinedSurfaces_3)
polycurve_bycurves_5 = Custom[[&] PolyCurve.ByCurves](curves=perimeterCurves_5)
curves_2 = PolyCurve.Curves(polyCurve=polycurve_bycurves_5)
endPoint_2 = Curve.EndPoint(curve=curves_2)
Z_4 = Point.Z(point=endPoint_2)
code_block_32 = CodeBlock { 0; }
eq_5 = Z_4 == code_block_32
filterByBoolMask_5 = List.FilterByBoolMask(list=curves_2, mask=eq_5)
code_block_33 = CodeBlock { 1; }
flatten_6 = List.Flatten(list=filterByBoolMask_5.out, amt=code_block_33)
code_block_34 = CodeBlock { false; }
clean = List.Clean(list=flatten_6, preserveIndices=code_block_34)

# group (continued): Get room boundary points and convert into proper WCS coordinates
startPoint_5 = Curve.StartPoint(curve=clean)
python_script_4 = Python(IN[0]=startPoint_5, IN[1]=X_3, IN[2]=Y_3, IN[3]=Z_3, IN[4]=getParameterValueByName_14)
# ---------- python_script_4.python (68 lines) ----------
# Load the Python Standard and DesignScript Libraries
import sys
import clr
clr.AddReference('RevitAPI')
from Autodesk.Revit.DB import *

clr.AddReference("RevitServices")
import RevitServices
from RevitServices.Persistence import DocumentManager
from RevitServices.Transactions import TransactionManager

clr.AddReference("RevitNodes")
import Revit
clr.ImportExtensions(Revit.Elements)
clr.ImportExtensions(Revit.GeometryConversion)
from Revit import GeometryConversion as gp

clr.AddReference('ProtoGeometry')
from Autodesk.DesignScript.Geometry import *


sys.path.append('C:\Program Files (x86)\IronPython 2.7\Lib')

import math


doc = DocumentManager.Instance.CurrentDBDocument

boundaries_in = IN[0]
easting = IN[1]
northing = IN[2]
elevation = IN[3] # this may be useful for multiple floors?
angle_deg = IN[4]


def get_x(point_x, point_y):
	x_out = (math.cos(math.radians(angle_deg[0])) * point_x) + (math.sin(math.radians(angle_deg[0])) * point_y) + easting[0]
	return x_out
	
def get_y(point_x, point_y):
	y_out = (math.sin(math.radians(angle_deg[0])) * (-1 * point_x)) + (math.cos(math.radians(angle_deg[0])) * point_y) + northing[0]
	return y_out
	
def to_m(num):
	out = num / 10000000
	return out


lists_out = []
for lines in boundaries_in:
	temp2 = []
	for points in lines:
		temp = []
		for point in points:
			temp.append([to_m(get_x(point.X, point.Y)), to_m(get_y(point.X, point.Y))])
		try:
			temp.append([to_m(get_x(points[0].X, points[0].Y)), to_m(get_y(points[0].X, points[0].Y))])
		except:
			pass
		temp2.append(temp)
	lists_out.append(temp2)
			
				

# Place your code below this line

# Assign your output to the OUT variable.
OUT = lists_out
# ----------------------------------------

name = Room.Name(room=all_rooms_2)
list_create_3 = List.Create(item0=python_script_4, item1=getParameterValueByName_4, item2=getParameterValueByName_5, item3=name, item4=getParameterValueByName_6, item5=getParameterValueByName_7, item6=getParameterValueByName_8, item7=getParameterValueByName_9, item8=getParameterValueByName_10, item9=getParameterValueByName_11, item10=getParameterValueByName_12, item11=getParameterValueByName_13)
code_block_file_name = CodeBlock { "json_roomdata-01"; }

# group: Take data from revit - put into GEOJSON format and export to json file (most of this done in python node)
transpose = List.Transpose(lists=list_create_3)
python_script_convert_line = Python(IN[0]=transpose, IN[1]=code_block_file_name)  # "Python Script: convert line strings to geojson"
# ---------- python_script_convert_line.python (68 lines) ----------
# Load the Python Standard and DesignScript Libraries
import sys
import clr
clr.AddReference('RevitAPI')
from Autodesk.Revit.DB import *

clr.AddReference("RevitServices")
import RevitServices
from RevitServices.Persistence import DocumentManager
from RevitServices.Transactions import TransactionManager

clr.AddReference("RevitNodes")
import Revit
clr.ImportExtensions(Revit.Elements)
clr.ImportExtensions(Revit.GeometryConversion)
from Revit import GeometryConversion as gp

clr.AddReference('ProtoGeometry')
from Autodesk.DesignScript.Geometry import *

sys.path.append('C:\Program Files (x86)\IronPython 2.7\Lib')

import json
import collections

items_in = IN[0]
filename = IN[1]

doc = DocumentManager.Instance.CurrentDBDocument

file_out = "C:\Users\daniel.odowd\OneDrive - Arup\DO_Documents\Software Development\ShortestPath\ShortestPath\pointsfiles\%s.json" % (filename)



	
geojson_out = {'type':'FeatureCollection', 'features':[]}
for objects in items_in:
	properties = {'Level' : objects[1], 
				  "Department" : objects[2], 
				  "Name" : objects[3],
				  "Number" : objects[4],
				  "Area" : objects[5],
				  "Space_Fire_Function" : objects[6],
				  "Project_Building_Purpose Group" : objects[7],
				  "Project_Building_Risk_Profile" : objects[8],
				  "Space_Fire_Smoke_Control_Type" : objects[9],
				  "Space_Fire_Detection_Category" : objects[10],
				  "Space_Fire_Suppression_Type" : objects[11],
				  }
	
	feature = {'type':'Feature', 
		'properties': {k:v for (k,v) in properties.items()},
		'geometry':{
			'type':'LineString', 
			'coordinates':[x for x in objects[0][0]],
			}
		}
	geojson_out['features'].append(feature)
  
	
with open(file_out, 'w') as outfile:
	json.dump(geojson_out, outfile, indent=4)


# Place your code below this line

# Assign your output to the OUT variable.
OUT = "complete"
# ----------------------------------------

centerBoundary = Room.CenterBoundary(room=all_elements_of_category_2)

# group: Obstacles Initialization
code_block_35 = CodeBlock(Obstacles=code_block_5.out3) { Obstacles; }
geometry = Element.Geometry(element=code_block_35)
flatten_7 = List.Flatten(list=geometry)
XY = Plane.XY()
code_block_36 = CodeBlock { 500; }
# note: Limit the solids to only those ones that intersect with a specific level
offset_7 = Plane.Offset(plane=XY, dist=code_block_36)
doesIntersect = Geometry.DoesIntersect(geometry=flatten_7, other=offset_7)
filterByBoolMask_6 = List.FilterByBoolMask(list=flatten_7, mask=doesIntersect)
# note: Union all the solids into a single object for easier detection.
byUnion_3 = Solid.ByUnion(solids=filterByBoolMask_6.in)

subtractFrom = Surface.SubtractFrom(surface=offset_3, trimmingEntity=byUnion_3)
code_block_37 = CodeBlock { 2; }
flatten_8 = List.Flatten(list=subtractFrom, amt=code_block_37)
faces_2 = Topology.Faces(topology=flatten_8)
code_block_38 = CodeBlock { 2; }
flatten_9 = List.Flatten(list=faces_2, amt=code_block_38)
surfaceGeometry = Face.SurfaceGeometry(face=flatten_9)
faces_3 = Topology.Faces(topology=surfaceGeometry)
edges_2 = Face.Edges(face=faces_3)
curveGeometry_2 = Edge.CurveGeometry(edge=edges_2)
code_block_39 = CodeBlock { 2; }
flatten_10 = List.Flatten(list=curveGeometry_2, amt=code_block_39)
polycurve_closedloopsfromcurves = Custom[[&] PolyCurve.ClosedLoopsFromCurves](curves=flatten_10)  # Find closed polycurves that enclose the "white spaces" from a network of planar, interesecting curves.
curves_3 = PolyCurve.Curves(polyCurve=polycurve_closedloopsfromcurves)
python_script_5 = Python(IN[0]=curves_3)
# ---------- python_script_5.python (41 lines) ----------
# Load the Python Standard and DesignScript Libraries
import sys
import clr
clr.AddReference('RevitAPI')
from Autodesk.Revit.DB import *

clr.AddReference("RevitServices")
import RevitServices
from RevitServices.Persistence import DocumentManager
from RevitServices.Transactions import TransactionManager

clr.AddReference("RevitNodes")
import Revit
clr.ImportExtensions(Revit.Elements)
clr.ImportExtensions(Revit.GeometryConversion)
from Revit import GeometryConversion as gp

clr.AddReference('ProtoGeometry')
from Autodesk.DesignScript.Geometry import *


sys.path.append('C:\Program Files (x86)\IronPython 2.7\Lib')

import math


doc = DocumentManager.Instance.CurrentDBDocument

curves_in = IN[0]

lists_out = []
for curves in curves_in:
	lists_out.append([curves])

			
				

# Place your code below this line

# Assign your output to the OUT variable.
OUT = lists_out
# ----------------------------------------
startPoint_6 = Curve.StartPoint(curve=python_script_5)
categories_9 = Categories(index=451)  # graph input
all_elements_of_category_4 = ElementsOfCategory(Category=categories_9)
string_5 = StringInput("E/W")  # graph input
X_4 = Element.GetParameterValueByName(element=all_elements_of_category_4, parameterName=string_5)
string_6 = StringInput("N/S")  # graph input
Y_4 = Element.GetParameterValueByName(element=all_elements_of_category_4, parameterName=string_6)
string_7 = StringInput("Elev")  # graph input
Z_5 = Element.GetParameterValueByName(element=all_elements_of_category_4, parameterName=string_7)
string_8 = StringInput("Angle to True North")  # graph input
getParameterValueByName_15 = Element.GetParameterValueByName(element=all_elements_of_category_4, parameterName=string_8)
python_script_6 = Python(IN[0]=startPoint_6, IN[1]=X_4, IN[2]=Y_4, IN[3]=Z_5, IN[4]=getParameterValueByName_15)  # same code as python_script_4
string_from_object_5 = FromObject(obj=polycurve_closedloopsfromcurves)
list_create_4 = List.Create(item0=python_script_6, item1=string_from_object_5)
transpose_2 = List.Transpose(lists=list_create_4)
code_block_file_name_2 = CodeBlock { "boundary_data"; }
python_script_convert_line_2 = Python(IN[0]=transpose_2, IN[1]=code_block_file_name_2)  # "Python Script: convert line strings to geojson"
# ---------- python_script_convert_line_2.python (57 lines) ----------
# Load the Python Standard and DesignScript Libraries
import sys
import clr
clr.AddReference('RevitAPI')
from Autodesk.Revit.DB import *

clr.AddReference("RevitServices")
import RevitServices
from RevitServices.Persistence import DocumentManager
from RevitServices.Transactions import TransactionManager

clr.AddReference("RevitNodes")
import Revit
clr.ImportExtensions(Revit.Elements)
clr.ImportExtensions(Revit.GeometryConversion)
from Revit import GeometryConversion as gp

clr.AddReference('ProtoGeometry')
from Autodesk.DesignScript.Geometry import *

sys.path.append('C:\Program Files (x86)\IronPython 2.7\Lib')

import json
import collections

items_in = IN[0]
filename = IN[1]

doc = DocumentManager.Instance.CurrentDBDocument

file_out = "C:\Users\daniel.odowd\OneDrive - Arup\DO_Documents\Software Development\ShortestPath\ShortestPath\pointsfiles\%s.json" % (filename)



	
geojson_out = {'type':'FeatureCollection', 'features':[]}
for objects in items_in:
	properties = {'object_name' : objects[1]}
	
	feature = {'type':'Feature', 
		'properties': {k:v for (k,v) in properties.items()},
		'geometry':{
			'type':'LineString', 
			'coordinates':[x for x in objects[0][0]],
			}
		}
	geojson_out['features'].append(feature)
  
	
with open(file_out, 'w') as outfile:
	json.dump(geojson_out, outfile, indent=4)


# Place your code below this line

# Assign your output to the OUT variable.
OUT = "complete"
# ----------------------------------------
perimeterCurves_6 = Surface.PerimeterCurves()  # unwired: surface
watch_3 = Watch(list_create_3)
