# Dynamo graph room-and-door-data-extractor_0.1.0.dyn (Dynamo 2.0.2.6826)

categories = Categories(index=425)  # graph input
all_elements_of_category = ElementsOfCategory(Category=categories)
all_rooms = CodeBlock(all_rooms=all_elements_of_category) { all_rooms; }

# group: Gets a bunch of parameters from the rooms
code_block = CodeBlock()
# ---------- code_block.designscript (11 lines) ----------
"Level";
"Department";
"Number";
"Name";
"Area";
"Space_Fire Safety_Accomodation_Function";
"Project_Building_Purpose Group";
"Project_Building_Risk_Profile";
"Space_Fire_Smoke_Control_Type";
"Space_Fire_Detection_Category";
"Space_Fire_Suppression_Type";
# ----------------------------------------
getParameterValueByName = Element.GetParameterValueByName(element=all_rooms, parameterName=code_block.out2)
getParameterValueByName_2 = Element.GetParameterValueByName(element=all_rooms, parameterName=code_block.out0)
getParameterValueByName_3 = Element.GetParameterValueByName(element=all_rooms, parameterName=code_block.out1)
getParameterValueByName_4 = Element.GetParameterValueByName(element=all_rooms, parameterName=code_block.out3)
getParameterValueByName_5 = Element.GetParameterValueByName(element=all_rooms, parameterName=code_block.out4)
getParameterValueByName_6 = Element.GetParameterValueByName(element=all_rooms, parameterName=code_block.out5)
getParameterValueByName_7 = Element.GetParameterValueByName(element=all_rooms, parameterName=code_block.out6)
getParameterValueByName_8 = Element.GetParameterValueByName(element=all_rooms, parameterName=code_block.out7)
getParameterValueByName_9 = Element.GetParameterValueByName(element=all_rooms, parameterName=code_block.out8)
getParameterValueByName_10 = Element.GetParameterValueByName(element=all_rooms, parameterName=code_block.out9)
getParameterValueByName_11 = Element.GetParameterValueByName(element=all_rooms, parameterName=code_block.out10)

# group: Get room boundary points and convert into proper WCS coordinates
finishBoundary = Room.FinishBoundary(room=all_rooms)
startPoint = Curve.StartPoint(curve=finishBoundary)
categories_2 = Categories(index=451)  # graph input
all_elements_of_category_2 = ElementsOfCategory(Category=categories_2)
string = StringInput("E/W")  # graph input
X = Element.GetParameterValueByName(element=all_elements_of_category_2, parameterName=string)
string_2 = StringInput("N/S")  # graph input
Y = Element.GetParameterValueByName(element=all_elements_of_category_2, parameterName=string_2)
string_3 = StringInput("Elev")  # graph input
Z = Element.GetParameterValueByName(element=all_elements_of_category_2, parameterName=string_3)
string_4 = StringInput("Angle to True North")  # graph input
getParameterValueByName_12 = Element.GetParameterValueByName(element=all_elements_of_category_2, parameterName=string_4)
convert_to_x_y_list_with_wcs = Python(IN[0]=startPoint, IN[1]=X, IN[2]=Y, IN[3]=Z, IN[4]=getParameterValueByName_12)  # "Convert to X,Y list (with WCS transform)"
# ---------- convert_to_x_y_list_with_wcs.python (68 lines) ----------
# Load the Python Standard and DesignScript Libraries
import sys
import clr
clr.AddReference('RevitAPI')
from Autodesk.Revit.DB import *

clr.AddReference("RevitServices")
import RevitServices
from RevitServices.Persistence import DocumentManager
from RevitServices.Transactions import TransactionManager

clr.AddReference("RevitNodes")
import Revit
clr.ImportExtensions(Revit.Elements)
clr.ImportExtensions(Revit.GeometryConversion)
from Revit import GeometryConversion as gp

clr.AddReference('ProtoGeometry')
from Autodesk.DesignScript.Geometry import *


sys.path.append('C:\Program Files (x86)\IronPython 2.7\Lib')

import math


doc = DocumentManager.Instance.CurrentDBDocument

boundaries_in = IN[0]
easting = IN[1]
northing = IN[2]
elevation = IN[3] # this may be useful for multiple floors?
angle_deg = IN[4]


def get_x(point_x, point_y):
	x_out = (math.cos(math.radians(angle_deg[0])) * point_x) + (math.sin(math.radians(angle_deg[0])) * point_y) + easting[0]
	return x_out
	
def get_y(point_x, point_y):
	y_out = (math.sin(math.radians(angle_deg[0])) * (-1 * point_x)) + (math.cos(math.radians(angle_deg[0])) * point_y) + northing[0]
	return y_out
	
def to_m(num):
	out = num / 10000000
	return out


lists_out = []
for lines in boundaries_in:
	temp2 = []
	for points in lines:
		temp = []
		for point in points:
			temp.append([to_m(get_x(point.X, point.Y)), to_m(get_y(point.X, point.Y))])
		try:
			temp.append([to_m(get_x(points[0].X, points[0].Y)), to_m(get_y(points[0].X, points[0].Y))])
		except:
			pass
		temp2.append(temp)
	lists_out.append(temp2)
			
				

# Place your code below this line

# Assign your output to the OUT variable.
OUT = lists_out
# ----------------------------------------

convert_to_x_y_list_no_wcs = Python(IN[0]=startPoint, IN[1]=X, IN[2]=Y, IN[3]=Z, IN[4]=getParameterValueByName_12)  # "Convert to X,Y list (no WCS transform)"
# ---------- convert_to_x_y_list_no_wcs.python (57 lines) ----------
# Load the Python Standard and DesignScript Libraries
import sys
import clr
clr.AddReference('RevitAPI')
from Autodesk.Revit.DB import *

clr.AddReference("RevitServices")
import RevitServices
from RevitServices.Persistence import DocumentManager
from RevitServices.Transactions import TransactionManager

clr.AddReference("RevitNodes")
import Revit
clr.ImportExtensions(Revit.Elements)
clr.ImportExtensions(Revit.GeometryConversion)
from Revit import GeometryConversion as gp

clr.AddReference('ProtoGeometry')
from Autodesk.DesignScript.Geometry import *


sys.path.append('C:\Program Files (x86)\IronPython 2.7\Lib')

import math


doc = DocumentManager.Instance.CurrentDBDocument

boundaries_in = IN[0]
#easting = IN[1]
#northing = IN[2]
#elevation = IN[3] # this may be useful for multiple floors?
#angle_deg = IN[4]


lists_out = []
for lines in boundaries_in:
	temp2 = []
	for points in lines:
		temp = []
		for point in points:
			#temp.append([to_m(get_x(point.X, point.Y)), to_m(get_y(point.X, point.Y))])
			temp.append([point.X, point.Y])
		try:
			temp.append([to_m(get_x(points[0].X, points[0].Y)), to_m(get_y(points[0].X, points[0].Y))])
			temp.append([points[0].X, points[0].Y])
		except:
			pass
		temp2.append(temp)
	lists_out.append(temp2)
			
				

# Place your code below this line

# Assign your output to the OUT variable.
OUT = lists_out
# ----------------------------------------
name = Room.Name(room=all_rooms)
list_create = List.Create(item0=convert_to_x_y_list_no_wcs, item1=getParameterValueByName_2, item2=getParameterValueByName_3, item3=name, item4=getParameterValueByName_4, item5=getParameterValueByName_5, item6=getParameterValueByName_6, item7=getParameterValueByName_7, item8=getParameterValueByName_8, item9=getParameterValueByName_9, item10=getParameterValueByName_10, item11=getParameterValueByName_11)
code_block_file_name = CodeBlock { "room-data-02"; }

# group: Take data from revit - put into GEOJSON format and export to json file (most of this done in python node)
transpose = List.Transpose(lists=list_create)
python_script_convert_line = Python(IN[0]=transpose, IN[1]=code_block_file_name)  # "Python Script: convert line strings to geojson"
# ---------- python_script_convert_line.python (68 lines) ----------
# Load the Python Standard and DesignScript Libraries
import sys
import clr
clr.AddReference('RevitAPI')
from Autodesk.Revit.DB import *

clr.AddReference("RevitServices")
import RevitServices
from RevitServices.Persistence import DocumentManager
from RevitServices.Transactions import TransactionManager

clr.AddReference("RevitNodes")
import Revit
clr.ImportExtensions(Revit.Elements)
clr.ImportExtensions(Revit.GeometryConversion)
from Revit import GeometryConversion as gp

clr.AddReference('ProtoGeometry')
from Autodesk.DesignScript.Geometry import *

sys.path.append('C:\Program Files (x86)\IronPython 2.7\Lib')

import json
import collections

items_in = IN[0]
filename = IN[1]

doc = DocumentManager.Instance.CurrentDBDocument

file_out = "C:\Users\daniel.odowd\OneDrive - Arup\DO_Documents\%s.json" % (filename)



	
geojson_out = {'type':'FeatureCollection', 'features':[]}
for objects in items_in:
	properties = {'Level' : objects[1], 
				  "Department" : objects[2], 
				  "Name" : objects[3],
				  "Number" : objects[4],
				  "Area" : objects[5],
				  "Space_Fire_Function" : objects[6],
				  "Project_Building_Purpose Group" : objects[7],
				  "Project_Building_Risk_Profile" : objects[8],
				  "Space_Fire_Smoke_Control_Type" : objects[9],
				  "Space_Fire_Detection_Category" : objects[10],
				  "Space_Fire_Suppression_Type" : objects[11],
				  }
	
	feature = {'type':'Feature', 
		'properties': {k:v for (k,v) in properties.items()},
		'geometry':{
			'type':'LineString', 
			'coordinates':[x for x in objects[0][0]],
			}
		}
	geojson_out['features'].append(feature)
  
	
with open(file_out, 'w') as outfile:
	json.dump(geojson_out, outfile, indent=4)


# Place your code below this line

# Assign your output to the OUT variable.
OUT = "complete"
# ----------------------------------------

categories_3 = Categories(index=159)  # graph input
all_elements_of_category_3 = ElementsOfCategory(Category=categories_3)
python_script = Python(IN[0]=all_elements_of_category_3)
# ---------- python_script.python (206 lines) ----------
import clr

import sys
sys.path.append(r'C:\Program Files (x86)\IronPython 2.7\Lib')
import os
import math

import System
from System import Array
from System.Collections.Generic import *

clr.AddReference('ProtoGeometry')
from Autodesk.DesignScript.Geometry import * 


clr.AddReference('RevitAPI')
import Autodesk
#from Autodesk.Revit.DB import *
from Autodesk.Revit.DB import Options
from Autodesk.Revit.DB import RevitLinkInstance
from Autodesk.Revit.DB import Point as dbPoint
from Autodesk.Revit.DB import XYZ

clr.AddReference("RevitNodes")
import Revit
clr.ImportExtensions(Revit.GeometryConversion)



clr.AddReference('System')
from System.Collections.Generic import List

clr.AddReference('RevitServices')
import RevitServices
from RevitServices.Persistence import DocumentManager
from RevitServices.Transactions import TransactionManager




doc = DocumentManager.Instance.CurrentDBDocument

options = Autodesk.Revit.DB.Options()

TransactionManager.Instance.EnsureInTransaction(doc)

#global list of failed doors for export
failed_doors = []


# Externally sourced function.
toList = lambda x : x if hasattr(x, '__iter__') else [x]
doors_in = toList(UnwrapElement(IN[0]))


# Externally sourced function.
def getHostLink(elem):
	hostRvt = elem.Host
	hostfaceref = elem.HostFace 
	if isinstance(hostRvt, RevitLinkInstance):
		linkdoc = hostRvt.GetLinkDocument()
		hostelem = linkdoc.GetElement(hostfaceref.LinkedElementId)
		return hostelem
	else:
		return 	hostRvt


def get_wall_doors(doors_in):
	""" filters doors from walls containedd in wall category"""
	wall_doors = []
	for door in doors_in:
		host = getHostLink(door)
		try:
			if host.GetType().Name.ToString() == "Wall":
				wall_doors.append(door)
		except:
			#TODO: this function should add warning to seperate list along with correct index of failure
			continue
			#wall_doors.append("WARNING - get_wall_doors() FAILED")
	return wall_doors


wall_doors = get_wall_doors(doors_in)	


def design_option_filter(elements_in):
	non_option_elements = []
	for elems in elements_in:
		if not elems.DesignOption:
			non_option_elements.append(elems)
		else:
			failed_doors.append(elems)
	return non_option_elements
			
		
filtered_doors = design_option_filter(wall_doors)	
door_objs_out = []	

bbox_out = []

def get_door_bbox(door_elems):
	for doors in door_elems:
		bbox_out.append(doors.get_BoundingBox(None))
get_door_bbox(filtered_doors)
		
		

def get_door_point_cloud(doors_in):
	""" Gets a point cloud of all a doors elements"""
	point_clouds = []
	for door in doors_in:
		door_obj = []
		#door_obj.append(door.GetParameters('Width_Clear Opening')[0].AsValueString())
		#door_obj.append(door.Location.Point.X)
		door_obj.append(door.get_BoundingBox(None))
		
		door_point_cloud = []
		door = door.get_Geometry(options)
		for component in door:
			solids = component.GetInstanceGeometry()
			for solid in solids:
				try:
					edges = solid.Edges
					for edge in edges:
						try:
							if edge.AsCurve():
								edge_curve = edge.AsCurve()
								if edge_curve.GetEndPoint(0):
									edge_endpoint = edge_curve.GetEndPoint(0)
									door_point_cloud.append(edge_endpoint)
									
								else:
									door_point_cloud.append("WARNING - could not get end point")
							else:
								door_point_cloud.append("WARNING - could not make edge as curve")
						except:
							points.append("WARNING - get curve endpoint failed")
				except:
					# TODO: this needs to log an error noting the door number/ id which failed.
					pass
		if len(door_point_cloud) > 0: 
			point_clouds.append(door_point_cloud)
			door_objs_out.append([door_obj])
			
			
		else:
			#failed_doors.append("WARNING - empty list")
			failed_doors.append(door)
	return point_clouds	
	
door_point_clouds = get_door_point_cloud(filtered_doors)


def centeroidpython(point_cloud_in):
	""" finds the centroid of a group of points"""
	# TODO: update script to use recursion so list depth is irrelivant.
	# Convert points cloud to nested list of points
	door_point_list = []
	for door in point_cloud_in:
		point_list = []
		for point in door:
			try:
				point_list.append([point.X, point.Y, point.Z])
			except:
				continue
		door_point_list.append(point_list)
	
	# Get centroid of each group of points in
	door_centroids = []	
	for door_pts in door_point_list:
		door_x = [points[0] for points in door_pts]
		door_y = [points[1] for points in door_pts]
		door_z = [points[2] for points in door_pts]
		l =  len(door_x)
		try:
			x_cent, y_cent, door_min = sum(door_x) / l, sum(door_y) / l, min(door_z)
			door_centroids.append([[XYZ(x_cent, y_cent, door_min).ToPoint()]])
			#door_centroids.append(XYZ(x_cent, y_cent, door_min))
		except:
			#TODO: we should return a separate list here with the index of failure
			door_centroids.append("WARNING - find centroid operation failed")
	return door_centroids 


def zvectors_from_points(points):
	points_in = UnwrapElement(points)
	start_end_points = []
	for p in points_in:
		#start_end_points.append(p.X)
		#start_end_points.append(dir(p))
		try:
			start_end_points.append([XYZ(float(p[0]), float(p[1]), float(p[2])), XYZ(float(p[0]), float(p[1]), float(p[2])+1)])
			
			
		except:
			start_end_points.append("could not be converted to float")
	return start_end_points
	
	

		
	
TransactionManager.Instance.TransactionTaskDone()

	
OUT = centeroidpython(door_point_clouds), failed_doors, bbox_out
# ----------------------------------------
failed_doors = CodeBlock(x=python_script) { x[1]; }
boundingBox = Element.BoundingBox(element=all_elements_of_category_3)
toPolySurface = BoundingBox.ToPolySurface(boundingBox=boundingBox)
surfaces = PolySurface.Surfaces(polySurface=toPolySurface)
python_script_2 = Python(IN[0]=surfaces)
# ---------- python_script_2.python (16 lines) ----------
# Enable Python support and load DesignScript library
import clr
clr.AddReference('ProtoGeometry')
from Autodesk.DesignScript.Geometry import *

# The inputs to this node will be stored as a list in the IN variables.
surfaces = IN[0]

out = []

# Place your code below this line
for surface in surfaces:
	out.append([surface[1]])

# Assign your output to the OUT variable.
OUT = out
# ----------------------------------------
perimeterCurves = Surface.PerimeterCurves(surface=python_script_2)
startPoint_2 = Curve.StartPoint(curve=perimeterCurves)

# group: Transform to World Coordinates
categories_4 = Categories(index=451)  # graph input
all_elements_of_category_4 = ElementsOfCategory(Category=categories_4)
string_5 = StringInput("E/W")  # graph input
X_2 = Element.GetParameterValueByName(element=all_elements_of_category_4, parameterName=string_5)
string_6 = StringInput("N/S")  # graph input
Y_2 = Element.GetParameterValueByName(element=all_elements_of_category_4, parameterName=string_6)
string_7 = StringInput("Elev")  # graph input
Z_2 = Element.GetParameterValueByName(element=all_elements_of_category_4, parameterName=string_7)
string_8 = StringInput("Angle to True North")  # graph input
getParameterValueByName_13 = Element.GetParameterValueByName(element=all_elements_of_category_4, parameterName=string_8)
convert_to_x_y_list_with_wcs_2 = Python(IN[0]=startPoint_2, IN[1]=X_2, IN[2]=Y_2, IN[3]=Z_2, IN[4]=getParameterValueByName_13)  # "Convert to X,Y list (with WCS transform)"; same code as convert_to_x_y_list_with_wcs

door_centroid = CodeBlock(x=python_script) { x[0]; }

# group: Transform to World Coordinates
categories_5 = Categories(index=451)  # graph input
all_elements_of_category_5 = ElementsOfCategory(Category=categories_5)
string_9 = StringInput("E/W")  # graph input
X_3 = Element.GetParameterValueByName(element=all_elements_of_category_5, parameterName=string_9)
string_10 = StringInput("N/S")  # graph input
Y_3 = Element.GetParameterValueByName(element=all_elements_of_category_5, parameterName=string_10)
string_11 = StringInput("Elev")  # graph input
Z_3 = Element.GetParameterValueByName(element=all_elements_of_category_5, parameterName=string_11)
string_12 = StringInput("Angle to True North")  # graph input
getParameterValueByName_14 = Element.GetParameterValueByName(element=all_elements_of_category_5, parameterName=string_12)
convert_to_x_y_list_with_wcs_3 = Python(IN[0]=door_centroid, IN[1]=X_3, IN[2]=Y_3, IN[3]=Z_3, IN[4]=getParameterValueByName_14)  # "Convert to X,Y list (with WCS transform)"
# ---------- convert_to_x_y_list_with_wcs_3.python (70 lines) ----------
# Load the Python Standard and DesignScript Libraries
import sys
import clr
clr.AddReference('RevitAPI')
from Autodesk.Revit.DB import *

clr.AddReference("RevitServices")
import RevitServices
from RevitServices.Persistence import DocumentManager
from RevitServices.Transactions import TransactionManager

clr.AddReference("RevitNodes")
import Revit
clr.ImportExtensions(Revit.Elements)
clr.ImportExtensions(Revit.GeometryConversion)
from Revit import GeometryConversion as gp

clr.AddReference('ProtoGeometry')
from Autodesk.DesignScript.Geometry import *


sys.path.append('C:\Program Files (x86)\IronPython 2.7\Lib')

import math


doc = DocumentManager.Instance.CurrentDBDocument

boundaries_in = IN[0]
easting = IN[1]
northing = IN[2]
elevation = IN[3] # this may be useful for multiple floors?
angle_deg = IN[4]


def get_x(point_x, point_y):
	x_out = (math.cos(math.radians(angle_deg[0])) * point_x) + (math.sin(math.radians(angle_deg[0])) * point_y) + easting[0]
	return x_out
	
def get_y(point_x, point_y):
	y_out = (math.sin(math.radians(angle_deg[0])) * (-1 * point_x)) + (math.cos(math.radians(angle_deg[0])) * point_y) + northing[0]
	return y_out
	
def to_m(num):
	out = num / 10000000
	return out


lists_out = []
for lines in boundaries_in:
	temp2 = []

	for points in lines:
		temp = []
		
		for point in points:
			temp.append([to_m(get_x(point.X, point.Y)), to_m(get_y(point.X, point.Y))])
		try:
			temp.append([to_m(get_x(points[0].X, points[0].Y)), to_m(get_y(points[0].X, points[0].Y))])
		except:
			pass
		temp2.append(temp[0])
	lists_out.append(temp2)
			
				

# Place your code below this line

# Assign your output to the OUT variable.
OUT = lists_out
# ----------------------------------------

code_block_2 = CodeBlock()
# ---------- code_block_2.designscript (6 lines) ----------
"Level";
"Number";
"Asset_Fire Safety_Exit_Type";
"Width_Clear_Opening";
"Asset_Fire Safety_Resistance_Requirement";
"Asset_Fire Safety_Exit_Type";
# ----------------------------------------
getParameterValueByName_15 = Element.GetParameterValueByName(element=all_elements_of_category_3, parameterName=code_block_2.out0)
code_block_3 = CodeBlock { "Name"; }
getParameterValueByName_16 = Element.GetParameterValueByName(element=getParameterValueByName_15, parameterName=code_block_3)
getParameterValueByName_17 = Element.GetParameterValueByName(element=all_elements_of_category_3, parameterName=code_block_2.out1)
getParameterValueByName_18 = Element.GetParameterValueByName(element=all_elements_of_category_3, parameterName=code_block_2.out2)
getParameterValueByName_19 = Element.GetParameterValueByName(element=all_elements_of_category_3, parameterName=code_block_2.out3)
getParameterValueByName_20 = Element.GetParameterValueByName(element=all_elements_of_category_3, parameterName=code_block_2.out3)
getParameterValueByName_21 = Element.GetParameterValueByName(element=all_elements_of_category_3, parameterName=code_block_2.out4)
getParameterValueByName_22 = Element.GetParameterValueByName(element=all_elements_of_category_3, parameterName=code_block_2.out5)
list_create_2 = List.Create(item0=convert_to_x_y_list_with_wcs_2, item1=convert_to_x_y_list_with_wcs_3, item2=getParameterValueByName_16, item3=getParameterValueByName_17, item4=getParameterValueByName_18, item5=getParameterValueByName_19, item6=getParameterValueByName_20, item7=getParameterValueByName_21, item8=getParameterValueByName_22)
transpose_2 = List.Transpose(lists=list_create_2)
code_block_file_name_2 = CodeBlock { "door-data-02"; }
python_script_convert_line_2 = Python(IN[0]=transpose_2, IN[1]=code_block_file_name_2)  # "Python Script: convert line strings to geojson"
# ---------- python_script_convert_line_2.python (66 lines) ----------
# Load the Python Standard and DesignScript Libraries
import sys
import clr
clr.AddReference('RevitAPI')
from Autodesk.Revit.DB import *

clr.AddReference("RevitServices")
import RevitServices
from RevitServices.Persistence import DocumentManager
from RevitServices.Transactions import TransactionManager

clr.AddReference("RevitNodes")
import Revit
clr.ImportExtensions(Revit.Elements)
clr.ImportExtensions(Revit.GeometryConversion)
from Revit import GeometryConversion as gp

clr.AddReference('ProtoGeometry')
from Autodesk.DesignScript.Geometry import *

sys.path.append('C:\Program Files (x86)\IronPython 2.7\Lib')

import json
import collections

items_in = IN[0]
filename = IN[1]

doc = DocumentManager.Instance.CurrentDBDocument

#file_out = "C:\Users\daniel.odowd\OneDrive - Arup\DO_Documents\%s.json" % (filename)
file_out = "C:\Users\daniel.odowd\Documents\TEMP\%s.json" % (filename)





	
geojson_out = {'type':'FeatureCollection', 'features':[]}
for objects in items_in:
	properties = {"Door_Centre" : objects[1],
				  "Level" : objects[2], 
				  "Number" : objects[3], 
				  "Asset_Fire Safety_Exit_Type" : objects[4],
				  "Width_Clear_Opening" : objects[5],
				  "Asset_Fire Safety_Resistance_Requirement" : objects[6]
				  }
	
	feature = {'type':'Feature', 
		'properties': {k:v for (k,v) in properties.items()},
		'geometry':{
			'type':'LineString', 
			'coordinates':[x for x in objects[0][0]],
			}
		}
	geojson_out['features'].append(feature)
  
	
with open(file_out, 'w') as outfile:
	json.dump(geojson_out, outfile, indent=4)


# Place your code below this line

# Assign your output to the OUT variable.
OUT = "complete"
# ----------------------------------------
watch = Watch(transpose)
door_bbox = CodeBlock(x=python_script) { x[2]; }
byJoinedSurfaces = Solid.ByJoinedSurfaces()  # unwired: facesOfSolid
